# Grasshopper definition rho.gh (Grasshopper 1.0.8)

construct_domain = ConstructDomain(DomainStart=0, DomainEnd=Slider(42, range=0..1000))
range = Range(Domain=construct_domain, Steps=Slider(570, range=10..1000))
cosine = Cosine(Value=range)
multiplication = Multiplication(A=cosine, B=Slider(1, range=0..20))
jitter = Jitter(List=multiplication, Jitter=Slider(0.011184, range=0..1), Seed=Slider(4, range=1..100))  # -> Values, Indices

construct_point = ConstructPoint(XCoordinate=range, YCoordinate=jitter.Values, ZCoordinate=0)
polyline = PolyLine(Vertices=construct_point, Closed=False)

python_3_script = Python3Script(x=construct_point)  # -> out, a; inputs x: list of Point3d
# ---------- python_3_script: Python ----------
"""Grasshopper Script (With Numpy)"""
# requirements: numpy

import numpy as np
from Rhino.Geometry import Point3d

# numpy array with random values
a = 0
b = 5

for i in x[a:b]:
    print(i.X)
# ---------- end python_3_script ----------

average = Average(Input=jitter.Values)
subtraction = Subtraction(A=jitter.Values, B=average)
mass_addition = MassAddition(Input=subtraction)  # -> Result, PartialResults
colour_picker = ColourPicker(PickedColour=RGB(42, 175, 201))
construct_point_2 = ConstructPoint(XCoordinate=range, YCoordinate=mass_addition.PartialResults, ZCoordinate=0)
polyline_2 = PolyLine(Vertices=construct_point_2, Closed=False)
custom_curve_preview = CustomCurvePreview(Curve=polyline_2, Linetype={Path="(Continuous)", Segments=[]}, Colour=colour_picker)
